# Grasshopper definition BuildingMaterial.gh (Grasshopper 1.0.8)
# plug-ins: UMCF

asphalt_concrete = AsphaltConcreteMaterial()

# ---- group: Calcium Silicate
calciumsilicate = CalciumSilicateMaterial()

# ---- group: Hamstad5Insulation
_5insulation = Hamstad5InsulationMaterial()

# ---- group: HamstadBrick
brick = HamstadBrickMaterial()

# ---- group: HamstadConcrete
concrete = HamstadConcreteMaterial()

# ----
impermeable = ImpermeableMaterial()
brick_2 = SabaBrickMaterial()
limestone = SavonnieresMaterial()

# ---- group: VanGenuchtenVapDiff
soil = VanGenuchtenVapDiffMaterial()

# ----
_5brick = Hamstad5BrickMaterial()

# ---- group: Hamstad5Mortar
mortar = Hamstad5MortarMaterial()

# ---- group: HamstadCase2
generic = HamstadCase2Material()

# ---- group: HamstadPlaster
plaster = HamstadPlasterMaterial()

# ---- group: Porous Asphalt
asphalt = PorousAsphaltMaterial()

# ----
brick_3 = SabaBrickModMaterial()
soil_2 = SoilMaterial()

# ---- group: VanGenutchen Material
soil_3 = VanGenuchtenMaterial()

# ---- group: Buildings Mesh
# Solid Region (Buildings)
mesh = Mesh(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)

# ---- group: Vegetation Mesh
# Vegetation Region
mesh_2 = Mesh(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)

# ----
# Air Region
number_slider = Slider(1, range=0..10)
X = UnitX(Factor=1)
rotate = Rotate(Geometry=X, Angle=degrees(Slider(0, range=0..100)), Plane=PlaneXY(0, 0, 0))  # -> Geometry, Transform
abl = ABLCondition(WindSpeed=number_slider, Height=Slider(10, range=0..10), WindDirection=rotate.Geometry)
boxdomaindim = BoxDomainDimensions(
    CellSize=Slider(10, range=0..100),
    FrontAdd=Slider(100, range=0..100),
    BackAdd=Slider(50, range=0..100),
    SidesAdd=Slider(29.6, range=0..100),
    TopAdd=Slider(21.6, range=0..100),
    RefinementBoxAdd=Slider(9.8, range=0..100))
airregion = AirRegion(ABLConditionSetting=abl, BoxDomainParameters=boxdomaindim)

solidmeshparas = SolidMeshParameters()

vegproperties = VegetationProperties()
vegmeshmeshsettings = VegetationMeshSettings()
swatch = ColourSwatch(SwatchColor=RGB(0, 191, 61))
material = CreateMaterial(Diffuse=swatch, Specular=swatch, Emission=RGB(0, 0, 0), Transparency=Slider(0.9, range=0..1), Shine=0)
vegregion = VegetationRegion(VegetationMesh=mesh_2, LAD=Slider(1, range=0..1), VegetationProperties=vegproperties, MeshParameters=vegmeshmeshsettings)
preview = CustomPreview(Geometry=mesh_2, Material=material)

swatch_2 = ColourSwatch(SwatchColor=RGB(0, 0, 0))
material_2 = CreateMaterial(Diffuse=swatch_2, Specular=swatch_2, Emission=RGB(0, 0, 0), Transparency=Slider(0.7, range=0..1), Shine=0)
preview_2 = CustomPreview(Geometry=mesh, Material=material_2)
solidregion = SolidRegion(Mesh=mesh, Material=brick_2, MeshParameters=solidmeshparas, BuildingTemperature=Slider(20, range=0..100))

# ---- group: Include a .epw weather file and connect to first input of Timing component
# Weather
path = FilePath("C:\Users\makel\Documents\ARQ\GT\Fall 2024\VIP Surrogate Models\USA_GA_Fulton.County.AP-Brown.Field.722195_TMY3.epw")
weather = Weather(EPWFilePath=path)

# ----
duration = Slider(12, range=0..24)
timing = TimingParameters(Weather=weather, StartDay=Slider(182, range=0..364), StartTime=Slider(7, range=0..23), Duration=duration)

# ----
# Simulation settings
number_slider_2 = Slider(10, range=0..20)
simsettings = SimulationSettings(NumberOfCPUs=number_slider_2, MaxFluidIteration=Slider(100, range=0..1000))

# ---- group: Working Directory
path_2 = FilePath("C:\MetaFoam_Cases\")

# ----
write = Button()
clear = Button()
umcf_case = UrbanMicroClimateFoamCase(
    WriteCase=write,
    ClearCase=clear,
    NewCaseName="building_tutorial_1",
    WorkingDirectory=path_2,
    AirRegion=airregion,
    VegetationRegion=vegregion,
    BuildingRegion=solidregion,
    TimingSettings=timing,
    SimulationSettings=simsettings)  # -> ModificationLogs, Case, DomainBox, RefinementBox

# ----
# Simulation
# (prepare and run using the same type of process)
prepare_simulation = Button()
run_simulation = Button()

# ---- group: Domain box
wires = BrepWireframe(Brep=umcf_case.DomainBox, Density=-1)
preview_3 = CustomPreview(Geometry=wires, Material=ColourSwatch(SwatchColor=RGB(0, 0, 0)))

# ---- group: Refinement box
wires_2 = BrepWireframe(Brep=umcf_case.RefinementBox, Density=-1)
preview_4 = CustomPreview(Geometry=wires_2, Material=ColourSwatch(SwatchColor=RGB(5, 67, 240)))

# ----
prepare_simulation_in_parallel = Button()
run_simulation_in_parallel = Button()

caserun = CaseRun(
    Case=umcf_case.Case,
    PrepareSimulation=prepare_simulation,
    PrepareSimulationInParallel=prepare_simulation_in_parallel,
    RunSimulation=run_simulation,
    RunSimulationInParallel=run_simulation_in_parallel)  # -> Case, LogFileNames, LogFileContent

mesh_3 = Mesh(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)
demesh = DeconstructMesh(Mesh=mesh_3)  # -> Vertices, Faces, Colours, Normals

# ---- group: Hour
number_slider_3 = Slider(4, range=1..12)

# ----
# Probing controls
# Define the fields for probing
# Name of region to probe
panel = Panel("buildings")
# Name of probing results
panel_2 = Panel("probing_building")
fields = Panel("""pc
Ts
ws""")

probing = Probing(Run=Button(), Case=umcf_case.Case, ProbingName=panel_2, Region=panel, Fields=fields, ProbingPoints=demesh.Vertices)

getprobes = GetProbes(Case=probing, Region=panel, ProbingName=panel_2, Field="Ts")  # -> TimeSteps, simplify(ProbeValues)
getprobes_2 = GetProbes(Case=probing, Region=panel, ProbingName=panel_2, Field="pc")  # -> TimeSteps, simplify(ProbeValues)
getprobes_3 = GetProbes(Case=probing, Region=panel, ProbingName=panel_2, Field="ws")  # -> TimeSteps, simplify(ProbeValues)

branch = TreeBranch(Tree=getprobes.ProbeValues, Path=number_slider_3, MaintainPaths=True)
branch_2 = TreeBranch(Tree=getprobes_2.ProbeValues, Path=number_slider_3, MaintainPaths=True)
branch_3 = TreeBranch(Tree=getprobes_3.ProbeValues, Path=number_slider_3, MaintainPaths=True)
bnd = Bounds(Numbers=branch)
bnd_2 = Bounds(Numbers=branch_2)
bnd_3 = Bounds(Numbers=branch_3)
panel_3 = Panel(bnd)
dedomain = DeconstructDomain(Domain=bnd)  # -> Start, End
panel_4 = Panel(bnd_2)
dedomain_2 = DeconstructDomain(Domain=bnd_2)  # -> Start, End
panel_5 = Panel(bnd_3)
dedomain_3 = DeconstructDomain(Domain=bnd_3)  # -> Start, End
gradient = Gradient(
    LowerLimit=dedomain.End,
    UpperLimit=dedomain.Start,
    Parameter=branch,
    stops=[0: RGB(234, 38, 0), 0.25: RGB(234, 126, 0), 0.5: RGB(254, 244, 84), 0.75: RGB(173, 203, 249), 1: RGB(75, 107, 169)])
gradient_2 = Gradient(
    LowerLimit=dedomain_2.End,
    UpperLimit=dedomain_2.Start,
    Parameter=branch_2,
    stops=[0: RGB(234, 38, 0), 0.25: RGB(234, 126, 0), 0.5: RGB(254, 244, 84), 0.75: RGB(173, 203, 249), 1: RGB(75, 107, 169)])
gradient_3 = Gradient(
    LowerLimit=dedomain_3.End,
    UpperLimit=dedomain_3.Start,
    Parameter=branch_3,
    stops=[0: RGB(234, 38, 0), 0.25: RGB(234, 126, 0), 0.5: RGB(254, 244, 84), 0.75: RGB(173, 203, 249), 1: RGB(75, 107, 169)])
conmesh = ConstructMesh(Vertices=demesh.Vertices, Faces=demesh.Faces, Colours=gradient)
conmesh_2 = ConstructMesh(Vertices=demesh.Vertices, Faces=demesh.Faces, Colours=gradient_2)
conmesh_3 = ConstructMesh(Vertices=demesh.Vertices, Faces=demesh.Faces, Colours=gradient_3)
