# Grasshopper definition CheckInstall.gh (Grasshopper 1.0.8)
# plug-ins: UMCF

checkinstall = CheckInstallation(Check=Toggle(True), InstallUrbanMicroclimateFoam=Toggle(False))
panel = Panel(checkinstall)
