# Grasshopper definition GMSH.gh (Grasshopper 1.0.8)
# plug-ins: Eddy3D-Outdoor+

brep = Brep(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)
gmsh = GmshMesh(Brep=brep, MaxSize=1, MinSize=0.5, RunGmsh=Button())  # -> Mesh, Log
panel = Panel([gmsh.Log, gmsh.Mesh])
