# Grasshopper definition GT_Campus_Terrain.gh (Grasshopper 1.0.8)
# plug-ins: Eddy3D-Outdoor+

boolean_toggle = BooleanToggle(False)
boolean_toggle_2 = BooleanToggle(True)

# ---- group: Air Region
negative = Negative(Value=Slider(1, range=0..1))
vector_xyz = VectorXYZ(XComponent=negative, YComponent=0, ZComponent=0)  # -> Vector, Length
abl_condition = ABLCondition(WindSpeed=1, Height=10, WindDirection=vector_xyz.Vector, SurfaceRoughnessLength=0)
air_region = AirRegion(ABLConditionSetting=abl_condition)

# ---- group: Building Region
mesh = Mesh([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])
building_material = BuildingMaterial(MaterialIndex=Slider(3, range=0..10))
building_material_2 = BuildingMaterial(MaterialIndex=Slider(2, range=0..10))
mesh_join = MeshJoin(Meshes=mesh)
buildingmeshing = BuildingMeshingParameters(FeatureRefinement=4, MinimumSurfaceRefinement=3, MaximumSurfaceRefinement=3, NumberOfLayers=2)
building_region = BuildingRegion(
    M=mesh_join,
    Outer_Material=building_material_2,
    Inner_Material=building_material,
    Outer_Thickness=0.1,
    OT=0.08,
    MP=buildingmeshing,
    Building_Temperature=Slider(22, range=0..100))

# ----
check_install_engine = CheckInstallEngine(CheckDocker=boolean_toggle_2, PullImage=boolean_toggle_2, EngineMode=2)

# ---- group: Weather
panel = Panel("https://energyplus-weather.s3.amazonaws.com/asia_wmo_region_2/IND/IND_Ahmedabad.426470_IWEC/IND_Ahmedabad.426470_IWEC.epw")
c_script = CSharpScript(url=panel)  # -> out, epwPath; inputs url: String, saveTo: String
# ---------- c_script: C# ----------
using System;
using System.IO;
using System.Net;
using System.Net.Http;
using System.Linq;
using System.Collections;
using System.Collections.Generic;
using System.Runtime.InteropServices;

public class Script_Instance : GH_ScriptInstance
{

private void RunScript(string url, string saveTo, ref object epwPath){
  

epwPath = null;

    // --- 1. Validate URL ---
    if (string.IsNullOrWhiteSpace(url))
    {
        Print("Error: URL is empty.");
        return;
    }

    // --- 2. Determine Filename ---
    string fileName = "download.epw";
    try
    {
        if (Uri.TryCreate(url, UriKind.Absolute, out Uri uri))
            fileName = Path.GetFileName(uri.LocalPath);
        if (string.IsNullOrWhiteSpace(fileName)) fileName = "default.epw";
    }
    catch { }

    // --- 3. Determine Initial Directory ---
    string targetDir = string.Empty;

    // If 'saveTo' input is connected, try that first
    if (!string.IsNullOrWhiteSpace(saveTo))
    {
        targetDir = saveTo;
    }
    else
    {
        // Otherwise, try the Grasshopper File location
        var ghDoc = this.GrasshopperDocument;
        if (ghDoc != null && !string.IsNullOrEmpty(ghDoc.FilePath))
        {
            string ghDir = Path.GetDirectoryName(ghDoc.FilePath);
            string caseDir = Path.Combine(ghDir, "Case");
            targetDir = Directory.Exists(caseDir) ? caseDir : ghDir;
        }
        else
        {
            // If unsaved, go straight to Fallback
            targetDir = GetEddy3DWeatherPath();
        }
    }

    // --- 4. Robust Directory Creation (The Fix) ---
    // We try to create the target directory. If it fails (Access Denied/Bad Path),
    // we AUTOMATICALLY fallback to the safe User AppData folder.
    try
    {
        targetDir = targetDir.Trim().Trim('"');
        targetDir = Environment.ExpandEnvironmentVariables(targetDir);

        if (!Directory.Exists(targetDir))
        {
            Directory.CreateDirectory(targetDir);
        }
    }
    catch (System.UnauthorizedAccessException)
    {
        Print($"Access Denied to: {targetDir}");
        Print("Switched to safe default folder.");
        targetDir = GetEddy3DWeatherPath();
        Directory.CreateDirectory(targetDir); // Force create safe dir
    }
    catch (Exception ex)
    {
        Print($"Invalid path ({ex.Message}). Switched to default.");
        targetDir = GetEddy3DWeatherPath();
        Directory.CreateDirectory(targetDir);
    }

    // --- 5. Download Logic ---
    string finalPath = Path.Combine(targetDir, fileName);

    try
    {
        if (File.Exists(finalPath))
        {
            Print($"File exists: {finalPath}");
            epwPath = finalPath;
            return;
        }

        Print($"Downloading to: {finalPath}");
        
        using (var client = new WebClient())
        {
            client.DownloadFile(url, finalPath);
        }
        
        Print("Download complete.");
        epwPath = finalPath;
    }
    catch (Exception ex)
    {
        Print($"Download Error: {ex.Message}");
    }

}

// Helper to get the correct Eddy3D/Weather path on Mac or Windows
private string GetEddy3DWeatherPath()
{
    string basePath;
    bool isMac = RuntimeInformation.IsOSPlatform(OSPlatform.OSX);

    if (isMac)
    {
        // macOS: ~/Library/Application Support/Eddy3D/Weather
        string home = Environment.GetEnvironmentVariable("HOME");
        basePath = Path.Combine(home, "Library", "Application Support");
    }
    else
    {
        // Windows: %AppData%/Eddy3D/Weather
        basePath = Environment.GetFolderPath(Environment.SpecialFolder.ApplicationData);
    }

    return Path.Combine(basePath, "Eddy3D", "Weather");
}
}
# ---------- end c_script ----------
weather = Weather(EPWFilePath=c_script.epwPath)
timing_parameters = TimingParameters(Weather=weather, StartDay=Slider(0, range=0..364), StartTime=Slider(12, range=0..23), Duration=Slider(48, range=0..48))

# ---- group: Vegetation Region
mesh_2 = Mesh([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])
vegmeshmeshsettings = VegetationMeshSettings(FeatureRefinement=3)
mesh_join_2 = MeshJoin(Meshes=mesh_2)
vegetation_region = VegetationRegion(VegetationMesh=mesh_join_2, LAD=1, MeshParameters=vegmeshmeshsettings)

# ---- group: Terrain Region
terrain_surface_material = TerrainSurfaceMaterial(MaterialIndex=7)
soil_material = SoilMaterial()
terrain_region = TerrainRegion(SurfaceLayerMaterial=terrain_surface_material, SoilMaterial=soil_material)

# ----
panel_2 = Panel(check_install_engine)

# ---- group: Box Domain
boxdomaindim = BoxDomainDimensions(
    CellSize=Slider(15, range=0..100),
    FrontAdd=Slider(66, range=0..200),
    BackAdd=Slider(426, range=0..600),
    SidesAdd=Slider(82, range=0..200))

# ----
c_script_2 = CSharpScript()  # -> CaseFolder
# ---------- c_script_2: C# ----------
using System;
using System.IO;
using System.Runtime.InteropServices;

public class Script_Instance : GH_ScriptInstance
{

private void RunScript(ref object CaseFolder){
  
// 1. Determine the Path
    string targetDir;
    var ghDoc = this.GrasshopperDocument;

    if (ghDoc != null && !string.IsNullOrEmpty(ghDoc.FilePath))
    {
        // A. GH File IS Saved -> Use "Case" subfolder next to the .gh file
        string ghDir = Path.GetDirectoryName(ghDoc.FilePath);
        targetDir = Path.Combine(ghDir, "GT_Campus_Case");
    }
    else
    {
        // B. GH File NOT Saved -> Use Dynamic User AppData Folder
        targetDir = GetEddy3DPath();
    }

    // 2. Create Directory if it doesn't exist
    // This uses dynamic paths, so no "Access Denied" on wrong user names.
    try 
    {
        if (!Directory.Exists(targetDir))
        {
            Directory.CreateDirectory(targetDir);
        }
    }
    catch (Exception ex) 
    {
        Print($"Error creating folder: {ex.Message}");
        // Fallback to temp if absolutely everything fails
        targetDir = Path.GetTempPath();
    }

    // 3. Output
    CaseFolder = targetDir;

}

public string GetEddy3DPath()
{
    // Dynamically finds the correct User folder on Windows or Mac
    string basePath;
    bool isMac = RuntimeInformation.IsOSPlatform(OSPlatform.OSX);

    if (isMac)
    {
        // macOS: ~/Library/Application Support/Eddy3D/Weather
        string home = Environment.GetEnvironmentVariable("HOME");
        basePath = Path.Combine(home, "Library", "Application Support");
    }
    else
    {
        // Windows: C:\Users\<YOUR_NAME>\AppData\Roaming
        basePath = Environment.GetFolderPath(Environment.SpecialFolder.ApplicationData);
    }

    return Path.Combine(basePath, "Eddy3D-Outdoor+", "Weather");
}


}
# ---------- end c_script_2 ----------
outdoorplus_case = UrbanMicroClimateFoamCase(
    WriteCase=Button(),
    NewCaseName="CampusTestGH",
    WorkingDirectory=c_script_2,
    AirRegion=air_region,
    VegetationRegion=vegetation_region,
    BuildingRegion=building_region,
    TerrainRegion=terrain_region,
    DomainBoxParameters=boxdomaindim,
    TimingSettings=timing_parameters)  # -> ModificationLogs, Case, DomainBox, RefinementBox, TotalMesh, Building
parse_case_logs = ParseCaseLogs(Case=outdoorplus_case.Case, Refresh=False)  # -> LogSummary, Errors, LogFiles
panel_3 = Panel([parse_case_logs.LogFiles, parse_case_logs.Errors, parse_case_logs.LogSummary])

# ---- group: 2. Prepare and run
button = Button()
# To run simulation in parallel,
# set the toggle to true, then prepare and run.
button_2 = Button()

# ----
case_run = CaseRun(Case=outdoorplus_case.Case, PrepareSimulation=button, RunSimulation=button_2, Parallel=True)  # -> Case, Logs
geo = Geometry(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)
qrmesh = QuadRemesh(Geometry=geo, Settings={aqc=True, as=50, dhe=True, gci=0, null=False, pme=2, sa=0, tqc=2000})
number_slider = Slider(1, range=0..3)
deconstruct_mesh = DeconstructMesh(Mesh=qrmesh)  # -> Vertices, Faces, Colours, Normals
panel_4 = Panel("""T
U
w""")
probing = Probing(Case=case_run.Case, ProbeName="probing01", Fields=panel_4, ProbePoints=deconstruct_mesh.Vertices)

# ----
# Temperature (T) probe
panel_5 = Panel("T")
get_probes = GetProbes(Case=probing, ProbingName="probing01", Field=panel_5)  # -> TimeSteps, simplify(ProbeValues)
tree_branch = TreeBranch(Tree=get_probes.ProbeValues, Path=number_slider, MaintainPaths=True)
bounds = Bounds(Numbers=tree_branch)
deconstruct_domain = DeconstructDomain(Domain=bounds)  # -> Start, End
gradient = Gradient(
    LowerLimit=deconstruct_domain.End,
    UpperLimit=deconstruct_domain.Start,
    Parameter=tree_branch,
    stops=[0: RGB(234, 38, 0), 0.25: RGB(234, 126, 0), 0.5: RGB(254, 244, 84), 0.75: RGB(173, 203, 249), 1: RGB(75, 107, 169)])
construct_mesh = ConstructMesh(Vertices=deconstruct_mesh.Vertices, Faces=deconstruct_mesh.Faces, Colours=gradient)

# ----
# Humidity (w) probe
panel_6 = Panel("w")
get_probes_2 = GetProbes(Case=probing, ProbingName="probing01", Field=panel_6)  # -> TimeSteps, simplify(ProbeValues)
tree_branch_2 = TreeBranch(Tree=get_probes_2.ProbeValues, Path=number_slider, MaintainPaths=True)
bounds_2 = Bounds(Numbers=tree_branch_2)
deconstruct_domain_2 = DeconstructDomain(Domain=bounds_2)  # -> Start, End
gradient_2 = Gradient(
    LowerLimit=deconstruct_domain_2.End,
    UpperLimit=deconstruct_domain_2.Start,
    Parameter=tree_branch_2,
    stops=[0: RGB(234, 38, 0), 0.25: RGB(234, 126, 0), 0.5: RGB(254, 244, 84), 0.75: RGB(173, 203, 249), 1: RGB(75, 107, 169)])
construct_mesh_2 = ConstructMesh(Vertices=deconstruct_mesh.Vertices, Faces=deconstruct_mesh.Faces, Colours=gradient_2)

# ----
# Wind velocity (U) probe
panel_7 = Panel("U")
get_probes_3 = GetProbes(Case=probing, ProbingName="probing01", Field=panel_7)  # -> TimeSteps, ProbeValues
simplify_tree = SimplifyTree(Tree=get_probes_3.ProbeValues, Front=False)
construct_domain = ConstructDomain(DomainStart=Slider(1.8, range=0..3), DomainEnd=Slider(6.5, range=0..10))
tree_branch_3 = TreeBranch(Tree=simplify_tree, Path=number_slider, MaintainPaths=True)
vector_length = VectorLength(Vector=tree_branch_3)
bounds_3 = Bounds(Numbers=vector_length)
deconstruct_domain_3 = DeconstructDomain(Domain=bounds_3)  # -> Start, End
remap_numbers = RemapNumbers(Value=vector_length, Source=bounds_3, Target=construct_domain)  # -> Mapped, Clipped
gradient_3 = Gradient(
    LowerLimit=deconstruct_domain_3.End,
    UpperLimit=deconstruct_domain_3.Start,
    Parameter=vector_length,
    stops=[0: RGB(234, 38, 0), 0.25: RGB(234, 126, 0), 0.5: RGB(254, 244, 84), 0.75: RGB(173, 203, 249), 1: RGB(75, 107, 169)])
amplitude = Amplitude(Vector=tree_branch_3, Amplitude=remap_numbers.Mapped)
vector_display_ex = VectorDisplayEx(Point=deconstruct_mesh.Vertices, Vector=amplitude, Colour=gradient_3, Width=2)
