# Grasshopper definition MicroclimateSimulation_GridProbes.gh (Grasshopper 1.0.8)
# plug-ins: Pufferfish, Eddy3D, Eddy3D-Outdoor+

mesh = Mesh([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])
mesh_2 = Mesh([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])
mesh_3 = Mesh([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])
mesh_4 = Mesh([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])
mesh_5 = Mesh([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])
mesh_6 = Mesh([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])
select = SelectTemplate()
# Write / read case everytime
# after changing the goemetry
value_list = ValueList({"Rectilinear-simple": 0, "Courtyard": 1, "Checkered boxes": 2}, selected="Rectilinear-simple")
entwine = Entwine(Branch00=mesh_4, Branch01=mesh_5, Branch02=mesh_6, FlattenInputs=True)  # -> simplify(Result)
entwine_2 = Entwine(Branch00=mesh, Branch01=mesh_2, Branch02=mesh_3, FlattenInputs=True)  # -> simplify(Result)
# Vegetation region
tree_branch = TreeBranch(Tree=entwine, Path=value_list, MaintainPaths=True)

# ----
# Building region
# Increase length
# to reudce mesh faces
# Optimum no. of faces
# should be between 100 and 200
# for faster run time
# 0 = AsphaltConcrete
# 1 = CalciumSilicate
# 2 = Hamstad5Brick
# 3 = Hamstad5Insulation
# 4 = Hamstad5Mortar
# 5 = HamstadBrick
# 6 = HamstadCase2
# 7 = HamstadConcrete
# 8 = HamstadPlaster
# 9 = Impermeable
# 10 = PorousAsphalt
# 11 = SabaBrick
# 12 = SabaBrickMod
# 13 = Soil
# 14 = VanGenuchten
# 15 = VanGenuchtenVapDiff
number_slider = Slider(1, range=0..10)
# Building mesh
mesh_7 = Mesh(tree_branch)
building_meshing_parameters = BuildingMeshingParameters()
building_material = BuildingMaterial(MaterialIndex=Slider(0, range=0..15))
triremesh = TriRemesh(Geometry=mesh_7, Sharp=Toggle(True), Length=number_slider, Iterations=25)  # -> Triangulation, Dual, Creases

tree_branch_2 = TreeBranch(Tree=entwine_2, Path=value_list, MaintainPaths=True)

# ----
# Increase length
# to reudce mesh faces
# Optimum no. of faces
# should be between 100 and 200
# for faster run time
number_slider_2 = Slider(2, range=0..10)
# Vegetation mesh
mesh_8 = Mesh(tree_branch_2)
vegetation_mesh_settings = VegetationMeshSettings()
vegetation_properties = VegetationProperties()
triremesh_2 = TriRemesh(Geometry=mesh_8, Sharp=Toggle(True), Length=number_slider_2, Iterations=25)  # -> Triangulation, Dual, Creases
vegetation_region = VegetationRegion(
    VegetationMesh=triremesh_2.Triangulation,
    LAD=Slider(1, range=0..1),
    VegetationProperties=vegetation_properties,
    MeshParameters=vegetation_mesh_settings)

# ----
# Wind direction
# 0 = E
# 90 = N
# 180 = W
# 270 = S
number_slider_3 = Slider(0, range=0..360)
# Air region
unit_x = UnitX(Factor=1)
rotate = Rotate(Geometry=unit_x, Angle=degrees(number_slider_3), Plane=PlaneXY(0, 0, 0))  # -> Geometry, Transform
abl_condition = ABLCondition(WindSpeed=Slider(1, range=0..10), Height=Slider(10, range=0..10), WindDirection=rotate.Geometry)
air_region = AirRegion(ABLConditionSetting=abl_condition)

bldgmesh = BuildingMeshSettings(FeatureRefinement=4, SurfaceLevelMin=3, SurfaceLevelMax=3, LayerCount=2)
panel = Panel("https://energyplus-weather.s3.amazonaws.com/asia_wmo_region_2/IND/IND_Ahmedabad.426470_IWEC/IND_Ahmedabad.426470_IWEC.epw")
building_material_2 = BuildingMaterial(MaterialIndex=Slider(1, range=0..15))

# ----
# Simulation settings
number_slider_4 = Slider(4, range=0..20)
simulation_settings = SimulationSettings(NumberOfCPUs=number_slider_4, MaxFluidIteration=Slider(50, range=0..1000), DampingThickness="30")

c_script = CSharpScript()  # -> CaseFolder
# ---------- c_script: C# ----------
using System;
using System.IO;
using System.Runtime.InteropServices;

public class Script_Instance : GH_ScriptInstance
{

private void RunScript(ref object CaseFolder){
  
// 1. Determine the Path
    string targetDir;
    var ghDoc = this.GrasshopperDocument;

    if (ghDoc != null && !string.IsNullOrEmpty(ghDoc.FilePath))
    {
        // A. GH File IS Saved -> Use "Case" subfolder next to the .gh file
        string ghDir = Path.GetDirectoryName(ghDoc.FilePath);
        targetDir = Path.Combine(ghDir, "GT_Campus_Case");
    }
    else
    {
        // B. GH File NOT Saved -> Use Dynamic User AppData Folder
        targetDir = GetEddy3DPath();
    }

    // 2. Create Directory if it doesn't exist
    // This uses dynamic paths, so no "Access Denied" on wrong user names.
    try 
    {
        if (!Directory.Exists(targetDir))
        {
            Directory.CreateDirectory(targetDir);
        }
    }
    catch (Exception ex) 
    {
        Print($"Error creating folder: {ex.Message}");
        // Fallback to temp if absolutely everything fails
        targetDir = Path.GetTempPath();
    }

    // 3. Output
    CaseFolder = targetDir;

}

public string GetEddy3DPath()
{
    // Dynamically finds the correct User folder on Windows or Mac
    string basePath;
    bool isMac = RuntimeInformation.IsOSPlatform(OSPlatform.OSX);

    if (isMac)
    {
        // macOS: ~/Library/Application Support/Eddy3D/Weather
        string home = Environment.GetEnvironmentVariable("HOME");
        basePath = Path.Combine(home, "Library", "Application Support");
    }
    else
    {
        // Windows: C:\Users\<YOUR_NAME>\AppData\Roaming
        basePath = Environment.GetFolderPath(Environment.SpecialFolder.ApplicationData);
    }

    return Path.Combine(basePath, "Eddy3D-Outdoor+", "Weather");
}


}
# ---------- end c_script ----------
building = BuildingRegion(
    BuildingMesh=triremesh.Triangulation,
    OuterMaterial=building_material_2,
    InnerMaterial=building_material,
    OuterThickness=0.1,
    InnerThickness=0.1,
    MeshSettings=bldgmesh,
    BuildingTemperature=Slider(20, range=0..100))

# ----
# Vegetation region preview
colour_swatch = ColourSwatch(SwatchColor=RGBA(117, 191, 140, 20))
custom_preview = CustomPreview(Geometry=mesh_8, Material=colour_swatch)

# ----
# Building region preview
colour_swatch_2 = ColourSwatch(SwatchColor=RGBA(255, 255, 255, 20))
custom_preview_2 = CustomPreview(Geometry=triremesh.Triangulation, Material=colour_swatch_2)

# ----
# Box domain parameters
number_slider_5 = Slider(20, range=0..100)
box_domain_dimensions = BoxDomainDimensions(
    CellSize=number_slider_5,
    FrontAdd=Slider(50, range=0..300),
    BackAdd=Slider(100, range=0..300),
    SidesAdd=Slider(50, range=0..300),
    TopAdd=Slider(50, range=0..300),
    RefinementBoxAdd=Slider(20, range=0..100))

simulation_meshsettings = SimulationMeshSettings(
    BoxRefinementLevel=Slider(2, range=0..10),
    NCellsBetweenLevels=Slider(3, range=0..10),
    IncludedAngle=Slider(90, range=0..100))

# ----
# Wind vector display
number_slider_6 = Slider(79, range=0..100)
construct_point = ConstructPoint(XCoordinate=0, YCoordinate=0, ZCoordinate=0)
amplitude = Amplitude(Vector=rotate.Geometry, Amplitude=number_slider_6)
vector_display_ex = VectorDisplayEx(Point=construct_point, Vector=amplitude, Colour=RGB(0, 0, 0), Width=2)

case_name = Panel("Test_XWE")
mesh_to_polysurface = MeshToPolysurface(Mesh=mesh_7, Triangles=False, FaceMerge=False)

# ---- group: 1. Read / write
write = Button()
read = Button()

# ----
clear = Button()
path = FilePath("C:\Eddy3D-Cases\Test_X\")
file_path = FilePath("C:\MetaFoam_Cases\")
terrainmesh = TerrainMeshSettings(SurfaceLayerCount=4, SurfaceExpansionRatio=1.2, SoilLayerCount=4, SoilExpansionRatio=1.2)

# ---- group: Terrain Region
terrain_surface_material = TerrainSurfaceMaterial(MaterialIndex=7)
soil_material = SoilMaterial()
terrain_region = TerrainRegion(SurfaceLayerMaterial=terrain_surface_material, SoilMaterial=soil_material, TerrainMeshParameters=terrainmesh)

# ----
panel_2 = Panel(file_path)
# Timing settings
c_script_2 = CSharpScript(url=panel, saveTo=panel_2)  # -> out, epwPath; inputs url: String, saveTo: String
# ---------- c_script_2: C# ----------
// Grasshopper Script Instance
#region Usings
using System;
using System.Linq;
using System.Collections;
using System.Collections.Generic;
using System.Drawing;
using System.IO;
using System.Net.Http;
using System.Threading.Tasks;

using Rhino;
using Rhino.Geometry;

using Grasshopper;
using Grasshopper.Kernel;
using Grasshopper.Kernel.Data;
using Grasshopper.Kernel.Types;
#endregion

public class Script_Instance : GH_ScriptInstance
{
private void RunScript(string url, string saveTo, ref object epwPath)
{
  epwPath = null;

  try
  {
    // --- Validate URL ---
    if (string.IsNullOrWhiteSpace(url))
    {
      Print("URL is invalid.");
      return;
    }

    string urlFileName;
    try { urlFileName = System.IO.Path.GetFileName(new Uri(url).LocalPath); }
    catch { Print("URL is invalid."); return; }
    if (string.IsNullOrWhiteSpace(urlFileName)) urlFileName = "download.epw";

    // --- Decide destination path ---
    string filePath;

    if (string.IsNullOrWhiteSpace(saveTo))
    {
      // Use GH file's directory
      var ghDoc  = GrasshopperDocument; // <-- use this in C# Script
      var ghPath = ghDoc?.FilePath;

      if (string.IsNullOrEmpty(ghPath))
      {
        // fallback to Rhino document folder if available
        var rhPath = Rhino.RhinoDoc.ActiveDoc?.Path;
        var rhDir  = string.IsNullOrEmpty(rhPath) ? null : System.IO.Path.GetDirectoryName(rhPath);
        if (string.IsNullOrEmpty(rhDir))
        {
          Print("Grasshopper file is unsaved. Please save the .gh file or provide a destination path.");
          return;
        }
        Print("Grasshopper file is unsaved; saving to the Rhino document folder.");
        filePath = System.IO.Path.Combine(rhDir, urlFileName);
      }
      else
      {
        var ghDir = System.IO.Path.GetDirectoryName(ghPath);
        filePath  = System.IO.Path.Combine(ghDir, urlFileName);
      }
    }
    else
    {
      // Accept either a folder or a full file path
      string raw = saveTo.Trim().Trim('"');
      raw = Environment.ExpandEnvironmentVariables(raw);

      var ghDoc  = GrasshopperDocument; // <-- use this here too
      var ghPath = ghDoc?.FilePath;
      string baseRoot = !string.IsNullOrEmpty(ghPath)
        ? System.IO.Path.GetDirectoryName(ghPath)
        : System.IO.Directory.GetCurrentDirectory();

      string candidate = raw;
      if (!System.IO.Path.IsPathRooted(candidate))
        candidate = System.IO.Path.GetFullPath(System.IO.Path.Combine(baseRoot, candidate));

      bool endsWithSlash =
        candidate.EndsWith(System.IO.Path.DirectorySeparatorChar.ToString()) ||
        candidate.EndsWith(System.IO.Path.AltDirectorySeparatorChar.ToString());

      bool treatAsFolder = endsWithSlash || System.IO.Directory.Exists(candidate);

      if (treatAsFolder)
      {
        System.IO.Directory.CreateDirectory(candidate);
        filePath = System.IO.Path.Combine(candidate, urlFileName);
      }
      else
      {
        string dir = System.IO.Path.GetDirectoryName(candidate);
        if (!string.IsNullOrEmpty(dir)) System.IO.Directory.CreateDirectory(dir);
        filePath = candidate;
      }
    }

    // --- Skip download if exists ---
    if (System.IO.File.Exists(filePath))
    {
      Print($"File already exists at {filePath}, skipping download.");
      epwPath = filePath;
      return;
    }

    // --- Download synchronously ---
    using (var http = new System.Net.Http.HttpClient())
    using (var resp = http.GetAsync(url, System.Net.Http.HttpCompletionOption.ResponseHeadersRead).Result)
    {
      resp.EnsureSuccessStatusCode();
      using (var fs = new System.IO.FileStream(filePath, System.IO.FileMode.Create, System.IO.FileAccess.Write, System.IO.FileShare.None))
      {
        resp.Content.CopyToAsync(fs).Wait();
      }
    }

    Print($"File downloaded successfully to {filePath}");
    epwPath = filePath;
  }
  catch (Exception ex)
  {
    Print($"Failed to download file: {ex.Message}");
  }
}


}

public static class FileDownloader
{
    /// <summary>
    /// Asynchronously downloads a file from the specified URL and saves it to the given file path.
    /// </summary>
    /// <param name="url">The URL of the file to download.</param>
    /// <param name="filePath">The local file path to save the downloaded file.</param>
    public static async Task DownloadFileAsync(string url, string filePath)
    {
        // Validate inputs
        if (string.IsNullOrWhiteSpace(url))
            throw new ArgumentException("URL cannot be null or empty.", nameof(url));

        if (string.IsNullOrWhiteSpace(filePath))
            throw new ArgumentException("File path cannot be null or empty.", nameof(filePath));

        // Ensure the directory exists
        var directory = Path.GetDirectoryName(filePath);
        if (!string.IsNullOrEmpty(directory) && !Directory.Exists(directory))
        {
            Directory.CreateDirectory(directory);
        }

        try
        {
            // Download file using HttpClient
            using var httpClient = new HttpClient();
            using var response = await httpClient.GetAsync(url, HttpCompletionOption.ResponseHeadersRead);
            response.EnsureSuccessStatusCode();

            // Save the file
            await using var fileStream = new FileStream(filePath, FileMode.Create, FileAccess.Write, FileShare.None);
            await response.Content.CopyToAsync(fileStream);
        }
        catch (Exception ex)
        {
            Console.WriteLine($"Error downloading file: {ex.Message}");
            throw;
        }
    }
}
# ---------- end c_script_2 ----------

duration = Slider(2, range=0..24)
weather = Weather(EPWFilePath=c_script_2.epwPath)
timing_parameters = TimingParameters(Weather=weather, StartDay=Slider(174, range=0..364), StartTime=Slider(7, range=0..23), Duration=duration)

umcfcase = UMCFCase(
    ReadCase=read,
    WriteCase=write,
    ClearCase=clear,
    CaseName=case_name,
    WorkingDirectory=path,
    AirRegion=air_region,
    VegetationRegion=vegetation_region,
    BuildingRegion=building,
    TerrainRegion=terrain_region,
    DomainParameters=box_domain_dimensions,
    TimingSettings=timing_parameters,
    SimulationSettings=simulation_settings,
    SimulationMeshSettings=simulation_meshsettings)  # -> Logs, Case, DomainBox, RefinementBox, TotalMesh, Building

deconstruct_brep = DeconstructBrep(Brep=mesh_to_polysurface)  # -> Faces, Edges, Vertices
bounding_box = BoundingBox(Content=mesh_7, Plane=PlaneXY(0, 0, 0))  # -> Box, Box_2
# Probing plane
number_slider_7 = Slider(10, range=0..10)
deconstruct_brep_2 = DeconstructBrep(Brep=bounding_box.Box_2)  # -> Faces, Edges, Vertices
xy_plane = XYPlane(Origin=Point(0, 0, 0))
list_item = ListItem(List=deconstruct_brep.Edges, Index=4, Wrap=True)
list_item_2 = ListItem(List=deconstruct_brep.Faces, Index=4, Wrap=True)
list_item_3 = ListItem(List=deconstruct_brep_2.Faces, Index=4, Wrap=True)
list_item_4 = ListItem(List=flatten(list_item), Index=0, Wrap=True)
# Probing plane height
# between 0.1 and 0.9
# 0.1 = bottom, 0.9 = top
number_slider_8 = Slider(0.1, range=0.1..1.1)
plane_through_shape = PlaneThroughShape(Plane=xy_plane, Shape=flatten(umcfcase.TotalMesh), Inflate=number_slider_7, SectionLogic=False)
length = Length(Curve=list_item_4)
expression = Expression(x=number_slider_8, Expression="If(x≥0.9, 0.9, x)")
construct_domain = ConstructDomain(DomainStart=0, DomainEnd=length)
brep_brep = BrepBrep(BrepA=flatten(list_item_3), BrepB=plane_through_shape)  # -> Curves, Points
offset_curve = OffsetCurve(Curve=flatten(brep_brep.Curves), Distance=1, Corners=1)
remap_numbers = RemapNumbers(Value=expression, Source=Domain(0, 1), Target=construct_domain)  # -> Mapped, Clipped
boundary_surfaces = BoundarySurfaces(Edges=flatten([plane_through_shape, offset_curve]))
unit_z = UnitZ(Factor=remap_numbers.Mapped)
move = Move(Geometry=boundary_surfaces, Motion=unit_z)  # -> Geometry, Transform

# ----
# Refinement box preview
deconstruct_brep_3 = DeconstructBrep(Brep=umcfcase.RefinementBox)  # -> Faces, Edges, Vertices
custom_preview_3 = CustomPreview(Geometry=deconstruct_brep_3.Edges, Material=ColourSwatch(SwatchColor=RGB(255, 255, 255)))

check_install_engine = CheckInstallEngine(ReinstallUMCF=False, EngineMode=0)
panel_3 = Panel(check_install_engine)
# To run simulation in parallel,
# set the toggle to true, then prepare and run.
boolean_toggle = BooleanToggle(True)

# ---- group: 2. Prepare and run
button = Button()
button_2 = Button()

# ----
number_slider_9 = Slider(2, range=0..10)
case_run = CaseRun(Case=umcfcase.Case, PrepareSimulation=button, RunSimulation=button_2, Parallel=boolean_toggle)  # -> Case, Logs
parse_case_logs = ParseCaseLogs(Case=case_run.Case, Refresh=Button())  # -> LogSummary, Errors, LogFiles
panel_4 = Panel(case_run.Logs)
brep2pts = BrepToGridPoints(Geometry=move.Geometry, Spacing=number_slider_9, Run=True)  # -> Points, Status
number_slider_10 = Slider(1, range=0..3)
panel_5 = Panel([parse_case_logs.LogFiles, parse_case_logs.Errors, parse_case_logs.LogSummary])
panel_6 = Panel("""T
U
w
p""")
probing = Probing(Case=case_run.Case, ProbeName="probing01", Fields=panel_6, ProbePoints=brep2pts.Points)

# ----
# Wind velocity (U) probe
panel_7 = Panel("U")
get_probes = GetProbes(Case=probing, ProbingName="probing01", Field=panel_7)  # -> TimeSteps, ProbeValues
simplify_tree = SimplifyTree(Tree=get_probes.ProbeValues, Front=False)
construct_domain_2 = ConstructDomain(DomainStart=Slider(0.3, range=0..3), DomainEnd=Slider(3.3, range=0..10))
tree_branch_3 = TreeBranch(Tree=simplify_tree, Path=number_slider_10, MaintainPaths=True)
vector_length = VectorLength(Vector=tree_branch_3)
bounds = Bounds(Numbers=vector_length)
deconstruct_domain = DeconstructDomain(Domain=bounds)  # -> Start, End
remap_numbers_2 = RemapNumbers(Value=vector_length, Source=bounds, Target=construct_domain_2)  # -> Mapped, Clipped
gradient = Gradient(
    LowerLimit=deconstruct_domain.End,
    UpperLimit=deconstruct_domain.Start,
    Parameter=vector_length,
    stops=[0: RGB(48, 18, 59), 0.0294: RGB(56, 40, 112), 0.0588: RGB(63, 62, 156), 0.0882: RGB(68, 82, 193), 0.118: RGB(70, 102, 221), 0.147: RGB(71, 122, 241)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])
amplitude_2 = Amplitude(Vector=tree_branch_3, Amplitude=remap_numbers_2.Mapped)
panel_8 = Panel(deconstruct_domain.Start)
panel_9 = Panel(deconstruct_domain.End)
vector_display_ex_2 = VectorDisplayEx(Point=brep2pts.Points, Vector=amplitude_2, Colour=gradient, Width=2)

# ----
# Temperature (T) probe
panel_10 = Panel("T")
get_probes_2 = GetProbes(Case=probing, ProbingName="probing01", Field=panel_10)  # -> TimeSteps, simplify(ProbeValues)
tree_branch_4 = TreeBranch(Tree=get_probes_2.ProbeValues, Path=number_slider_10, MaintainPaths=True)
cir = Circle(Plane=brep2pts.Points, Radius=expr("x/2", number_slider_9))
srf = Surface(cir)

expression_2 = Expression(x=tree_branch_4, Expression="x-273.15")
roundd = RoundToDecimalPlace(NumberX=expression_2, DecimalPlace=1, RoundType=0)  # -> Rounded, Difference

bounds_2 = Bounds(Numbers=expression_2)
deconstruct_domain_2 = DeconstructDomain(Domain=bounds_2)  # -> Start, End
gradient_2 = Gradient(
    LowerLimit=deconstruct_domain_2.Start,
    UpperLimit=deconstruct_domain_2.End,
    Parameter=expression_2,
    stops=[0: RGB(48, 18, 59), 0.0294: RGB(56, 40, 112), 0.0588: RGB(63, 62, 156), 0.0882: RGB(68, 82, 193), 0.118: RGB(70, 102, 221), 0.147: RGB(71, 122, 241)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])
panel_11 = Panel(deconstruct_domain_2.Start)
panel_12 = Panel(deconstruct_domain_2.End)
preview = CustomPreview(Geometry=srf, Material=gradient_2)
tag = TextTag(Location=brep2pts.Points, Text=roundd.Rounded, Colour=RGB(0, 0, 0))

# ----
# Humidity (w) probe
# Pressure (p) probe
panel_13 = Panel("w")
get_probes_3 = GetProbes(Case=probing, ProbingName="probing01", Field=panel_13)  # -> TimeSteps, simplify(ProbeValues)
tree_branch_5 = TreeBranch(Tree=get_probes_3.ProbeValues, Path=number_slider_10, MaintainPaths=True)
cir_2 = Circle(Plane=brep2pts.Points, Radius=expr("x/2", number_slider_9))
srf_2 = Surface(cir_2)

get_probes_4 = GetProbes(Case=probing, ProbingName="probing01", Field="p")  # -> TimeSteps, simplify(ProbeValues)
tree_branch_6 = TreeBranch(Tree=get_probes_4.ProbeValues, Path=number_slider_10, MaintainPaths=True)
cir_3 = Circle(Plane=brep2pts.Points, Radius=expr("x/2", number_slider_9))
srf_3 = Surface(cir_3)

expression_3 = Expression(x=tree_branch_6, Expression="x-101325")
rh = RelativeHumidity(SpecificHumidity=tree_branch_5, Temperature=tree_branch_4, Pressure=tree_branch_6)

bounds_3 = Bounds(Numbers=expression_3)
deconstruct_domain_3 = DeconstructDomain(Domain=bounds_3)  # -> Start, End
gradient_3 = Gradient(
    LowerLimit=deconstruct_domain_3.Start,
    UpperLimit=deconstruct_domain_3.End,
    Parameter=expression_3,
    stops=[0: RGB(234, 38, 0), 0.25: RGB(234, 126, 0), 0.5: RGB(254, 244, 84), 0.75: RGB(173, 203, 249), 1: RGB(75, 107, 169)])
panel_14 = Panel(deconstruct_domain_3.Start)
panel_15 = Panel(deconstruct_domain_3.End)
preview_2 = CustomPreview(Geometry=srf_3, Material=gradient_3)

bounds_4 = Bounds(Numbers=rh)
deconstruct_domain_4 = DeconstructDomain(Domain=bounds_4)  # -> Start, End
gradient_4 = Gradient(
    LowerLimit=deconstruct_domain_4.Start,
    UpperLimit=deconstruct_domain_4.End,
    Parameter=rh,
    stops=[0: RGB(48, 18, 59), 0.0294: RGB(56, 40, 112), 0.0588: RGB(63, 62, 156), 0.0882: RGB(68, 82, 193), 0.118: RGB(70, 102, 221), 0.147: RGB(71, 122, 241)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])
preview_3 = CustomPreview(Geometry=srf_2, Material=gradient_4)

panel_16 = Panel(deconstruct_domain_4.Start)
panel_17 = Panel(deconstruct_domain_4.End)
